# Grasshopper definition Chameleon.gh (Grasshopper 0.9.14)
# plug-ins: Chameleon

crv = Curve(graft([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]))
end = EndPoints(Curve=crv)  # -> Start, End
pt_a = Point(end.Start)
vec2pt = Vector2Pt(PointA=end.Start, PointB=Point(0, 0, 0), Unitize=False)  # -> Vector, Length
vec2pt_2 = Vector2Pt(PointA=end.End, PointB=Point(0, 0, 0), Unitize=False)  # -> Vector, Length
pt_b = Point(end.End)
pcomp = Decompose(Point=vec2pt.Vector, System=PlaneXY(0, 0, 0))  # -> XComponent, YComponent, ZComponent
pcomp_2 = Decompose(Point=vec2pt_2.Vector, System=PlaneXY(0, 0, 0))  # -> XComponent, YComponent, ZComponent
bnd = Bounds(Numbers=flatten(pcomp.ZComponent))
bnd_2 = Bounds(Numbers=flatten(pcomp_2.ZComponent))
remap = RemapNumbers(Value=pcomp.ZComponent, Source=bnd, Target=Domain(0, 1))
remap_2 = RemapNumbers(Value=pcomp_2.ZComponent, Source=bnd_2, Target=Domain(0, 1))
amp = Amplitude(Vector=vec2pt.Vector, Amplitude=remap)
amp_2 = Amplitude(Vector=vec2pt_2.Vector, Amplitude=remap_2)
move = Move(Geometry=pt_a, Motion=amp)  # -> Geometry, Transform
move_2 = Move(Geometry=pt_b, Motion=amp_2)  # -> Geometry, Transform
pt_d = Point(move.Geometry)
pt_c = Point(move_2.Geometry)
pt_a_2 = Point(pt_a)
pt_b_2 = Point(pt_b)
merge = Merge(Data1=pt_a_2, Data2=pt_b_2, Data3=pt_c, Data4=pt_d)
revitac = PlaceRevitAdaptiveComponents(Activate=Toggle(False), Points=merge)
