# Grasshopper definition Geometry Gym.gh (Grasshopper 0.9.14)
# plug-ins: ggIFC

crv = Curve(graft([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]))
subset = SubList(List=flatten(crv), Domain="20", Cycle=False)  # -> graft(List), Index
end = EndPoints(Curve=crv)  # -> Start, End
pt_a = Point(end.Start)
vec2pt = Vector2Pt(PointA=end.Start, PointB=Point(0, 0, 0), Unitize=False)  # -> Vector, Length
vec2pt_2 = Vector2Pt(PointA=end.End, PointB=Point(0, 0, 0), Unitize=False)  # -> Vector, Length
pt_b = Point(end.End)
pcomp = Decompose(Point=vec2pt.Vector, System=PlaneXY(0, 0, 0))  # -> XComponent, YComponent, ZComponent
pcomp_2 = Decompose(Point=vec2pt_2.Vector, System=PlaneXY(0, 0, 0))  # -> XComponent, YComponent, ZComponent
number = Number(0.25)
_1_2 = Number(0.04166666667)
bnd = Bounds(Numbers=flatten(pcomp.ZComponent))
bnd_2 = Bounds(Numbers=flatten(pcomp_2.ZComponent))
bnd_3 = Bounds(Numbers=flatten(pcomp_2.ZComponent))
dom = Domain(DomainStart=number, DomainEnd=_1_2)
remap = RemapNumbers(Value=pcomp.ZComponent, Source=bnd, Target=".1 to 1")
remap_2 = RemapNumbers(Value=pcomp_2.ZComponent, Source=bnd_2, Target=".1 to 1")
remap_3 = RemapNumbers(Value=pcomp_2.ZComponent, Source=bnd_3, Target=dom)
amp = Amplitude(Vector=vec2pt.Vector, Amplitude=remap)
amp_2 = Amplitude(Vector=vec2pt_2.Vector, Amplitude=remap_2)
values = Number(remap_3)
move = Move(Geometry=pt_a, Motion=amp)  # -> Geometry, Transform
move_2 = Move(Geometry=pt_b, Motion=amp_2)  # -> Geometry, Transform
pt_d = Point(move.Geometry)
pt_a_2 = Point(pt_a)
pt_b_2 = Point(pt_b)
pt_c = Point(move_2.Geometry)
merge = Merge(Data1=pt_a_2, Data2=pt_b_2, Data3=pt_c, Data4=pt_d)
# IFC Vertex Point
pline = PolyLine(Vertices=merge, Closed=False)
ac_pt_1 = Point(Point(22, 0, 0))
ac_pt_2 = Point(Point(21, 22, 0))
ac_pt_3 = Point(Point(35, 22, 0))
ac_pt_4 = Point(Point(39, 6, 0))
merge_2 = Merge(Data1=ac_pt_1, Data2=ac_pt_2, Data3=ac_pt_3, Data4=ac_pt_4)
ggifcv = GgIFCVertexPoint(Point=merge_2)
# IFC Face
ggifcf = GgIFCFace(Vertex=ggifcv)
panel = Panel(ggifcv)
# IFC Connected Face Set
ggifccs = GgIFCConnectedFaceSet(ListIFCFaces=flatten(ggifcf))
ggifcrm = GgIFCRepresentationMap(IFCRepresentationItems=flatten(ggifccs))
ggifccwt = GgIFCCurtainWallType(IFCRepresentation=ggifcrm, Name="4_Pt_Plane")
# IFC Building
# IFC Representation Map
ggifcb = GgIFCBuilding(Name="Grasshopper Building", LongName="GH Building", Desc="GH Building", BuildingComposition="ELEMENT")
panel_2 = Panel(ggifccwt)
# IFC Curtain Wall Type
# IFC Curtain Wall
# (Adaptive Component)
ggifccwsc = GgIFCCurtainWallStandardCaseAdaptiveComponent(IFCContainer=ggifcb, IFCCurtainWallType=ggifccwt, PolyLineCurve=pline, ggIFC_ssiIds="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")
# IFC Project
ggifcp = GgIFCProject(Name="Grasshopper Project", SiteOrBuilding=ggifcb)
panel_3 = Panel(ggifccwsc)
# Bake IFC
ggbake = GgIFCBakeStructure(Radians=True, IFC2x4=False, Accurate=True, RepMapDXF=False)
