# Grasshopper definition Hummingbird.gh (Grasshopper 0.9.14)
# plug-ins: Hummingbird

crv = Curve(graft([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]))
end = EndPoints(Curve=crv)  # -> Start, End
pt_a = Point(end.Start)
vec2pt = Vector2Pt(PointA=end.Start, PointB=Point(0, 0, 0), Unitize=False)  # -> Vector, Length
vec2pt_2 = Vector2Pt(PointA=end.End, PointB=Point(0, 0, 0), Unitize=False)  # -> Vector, Length
pt_b = Point(end.End)
pcomp = Decompose(Point=vec2pt.Vector, System=PlaneXY(0, 0, 0))  # -> XComponent, YComponent, ZComponent
pcomp_2 = Decompose(Point=vec2pt_2.Vector, System=PlaneXY(0, 0, 0))  # -> XComponent, YComponent, ZComponent
number = Number(0.25)
_1_2 = Number(0.04166666667)
bnd = Bounds(Numbers=flatten(pcomp.ZComponent))
bnd_2 = Bounds(Numbers=flatten(pcomp_2.ZComponent))
bnd_3 = Bounds(Numbers=flatten(pcomp_2.ZComponent))
dom = Domain(DomainStart=number, DomainEnd=_1_2)
remap = RemapNumbers(Value=pcomp.ZComponent, Source=bnd, Target="0 to 1")
remap_2 = RemapNumbers(Value=pcomp_2.ZComponent, Source=bnd_2, Target="0 to 1")
remap_3 = RemapNumbers(Value=pcomp_2.ZComponent, Source=bnd_3, Target=dom)
amp = Amplitude(Vector=vec2pt.Vector, Amplitude=remap)
amp_2 = Amplitude(Vector=vec2pt_2.Vector, Amplitude=remap_2)
values = Number(remap_3)
move = Move(Geometry=pt_a, Motion=amp)  # -> Geometry, Transform
move_2 = Move(Geometry=pt_b, Motion=amp_2)  # -> Geometry, Transform
input_panel = Panel("P0")
values_2 = Number(values)
pt_d = Point(move.Geometry)
pt_a_2 = Point(pt_a)
pt_b_2 = Point(pt_b)
pt_c = Point(move_2.Geometry)
merge = Merge(Data1=pt_a_2, Data2=pt_b_2, Data3=pt_c, Data4=pt_d)
input_panel_2 = Panel("C:\Users\mmccune\##Computation\Hummingbird\Hummingbird.xlsx")
adapcomp = AdapComp(
    WriteToggle=Toggle(False),
    ExcelPath=input_panel_2,
    ExcelTabName="Adaptive Components",
    RevitFamilyName="4_Pt_Plane",
    RevitTypeName="4_Pt_Plane",
    Points=merge)
